# Grasshopper definition poligono_impressao.gh (Grasshopper 1.0.7)
# plug-ins: Kangaroo2 Components, Pufferfish

# ----
# POLIGONO BASE
number_slider = Slider(15, range=0..100)
polygon = Polygon(Plane=PlaneXY(0, 0, 0), Radius=number_slider, Segments=Slider(8, range=3..10), FilletRadius=0)  # -> Polygon, Length
boundary = BoundarySurfaces(Edges=polygon.Polygon)
Z = UnitZ(Factor=number_slider)
extr = Extrude(Base=boundary, Direction=Z)
debrep = DeconstructBrep(Brep=extr)  # -> Faces, Edges, Vertices

# ----
# Extrusão das linhas
# com pipe
panel = Panel("-0.5")
ext = ExtendCurve(Curve=debrep.Edges, Type=0, Start=panel, End=panel)
pipe = Pipe(Curve=ext, Radius="0.3", Caps=0)

# ---- group: CONECTOR LADO 1
len = Length(Curve=debrep.Edges)
subtraction = Subtraction(A=len, B="1")
ext_2 = ExtendCurve(Curve=debrep.Edges, Type=0, Start="0", End=expr("-x", subtraction))

# ---- group: CONECTOR LADO 2
len_2 = Length(Curve=debrep.Edges)
subtraction_2 = Subtraction(A=len_2, B="1")
ext_3 = ExtendCurve(Curve=debrep.Edges, Type=0, Start=expr("-x", subtraction_2), End="0")

# ----
# Extrusão dos conectores
mp = MultiPipe(Curves=[ext_2, ext_3], NodeSize="0.3", EndOffset=1, StrutSize=1, Segment=0, KinkAngle=0.6, CubeFit=0, Caps=0)

# ---- group: OFFSET DO PUFFERFISH
offsrf = OffsetSurface(Surface=mp, Distance="0.1", BothSides=0, CreateSolid=True)
